# Grasshopper definition visiting_geometric_architecture_1.gh (Grasshopper 1.0.7)

srf = Surface(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)
int = Integer(Slider(5, range=2..10))
int_2 = Integer(Slider(2500, range=0..5000))
int_3 = Integer(Slider(60, range=10..100))
num = Number(Slider(50, range=10..100))
int_4 = Integer(Slider(49, range=0..100))
srf_2 = Surface(srf)
num_2 = Number(int)
num_3 = Number(int_2)
int_5 = Integer(int_4)
srf_3 = Surface(srf)
int_6 = Integer(int_3)
sdivide = DivideSurface(Surface=srf_3, UCount=int_6, VCount="1")  # -> Points, Normals, Parameters
sdivide_2 = DivideSurface(Surface=srf_2, UCount=num_2, VCount=num_2)  # -> flatten(Points), Normals, Parameters
pline = PolyLine(Vertices=sdivide.Points, Closed=False)  # -> flatten(Polyline)
dom = ConstructDomain(DomainStart="0", DomainEnd=num_3)
lng = ListLength(List=sdivide_2.Points)
line = Line(pline)
random = Random(Range=dom, Number=lng, Seed=int_5)
Z = UnitZ(Factor=random)
expression = Expression(x=num_2, Expression="x + 1")
move = Move(Geometry=sdivide_2.Points, Motion=Z)  # -> Geometry, Transform
srfgrid = SurfaceFromPoints(Points=move.Geometry, UCount=expression, Interpolate=False)
srf_4 = Surface(srfgrid)
srf_5 = Surface(srf_4)
line_2 = Line(line)
num_4 = Number(num)
project = Project(Curve=line_2, Brep=srf_5, Direction=Vector(0, 0, 1))  # -> flatten(Curve)
pipe = Pipe(Curve=project, Radius=num_4, Caps=0)  # -> flatten(Pipe)
srf_6 = Surface(pipe)
